% Simulink data dictionary EgasPOC.sldd

WSS_Avg_Spd = Simulink.Parameter(3)
WhlSpd_Min = Simulink.Parameter(0)
WhlSpd_Max = Simulink.Parameter(32)
Whl_Stuck_Delta = Simulink.Parameter(0.08)
Wheel_Spd_Th = Simulink.Parameter(3)
Stuck_Th_Cyc = Simulink.Parameter(100)
Motor_Stuck_Delta = Simulink.Parameter(0.05)
Motor_Spd_Min = Simulink.Parameter(0)
Motor_Spd_Max = Simulink.Parameter(1023)
IMU_Stuck_Delta = Simulink.Parameter(0.05)
Accel_Max = Simulink.Parameter(32.767)
Alpha_Motor = Simulink.Parameter(0.45)
Alpha_WSS = Simulink.Parameter(0.35)
Alpha_Accel_IMU = Simulink.Parameter(0.15)
W1 = Simulink.Parameter(0.3)
W2 = Simulink.Parameter(0.7)
DT = Simulink.Parameter(0.01)

SG_mWhdStat_IDT_E2E = Simulink.Bus(HeaderFile="Rte_Type.h")
  HwEnblStat: boolean
  MsgCntr_mWhdStat: uint8
  MsgCrc_mWhdStat: uint8
  MtrSpd: single
  MtrTrqEst: single
  MvCurrEst: single
  MvVolt: single
  TrqEnblStat: boolean
  CanVm64FltCod: uint8

SG_mVcuImuLinAccel_IDT = Simulink.Bus(HeaderFile="Rte_Type.h")
  MsgCntr_ImuLin: uint8
  MsgCrc_ImuLin: uint8
  X_Accel: single
  Y_Accel: single
  Z_Accel: single

SG_mEbcm2L_WhlSpd_IDT_E2E = Simulink.Bus(HeaderFile="Rte_Type.h")
  MsgCntr_mEbcm2L_WhlSpd: uint8
  MsgCrc_mEbcm2L_WhlSpd: uint8
  WhlSpdFL: single
  WhlSpdFR: single
  WhlSpdR: single
  CanVm7FFltCod: uint8

IF_ValidityFlag_L1p_IDT = Simulink.Bus(HeaderFile="Rte_Type.h")
  Motor_RPM_Valid_Flg: boolean
  WSS_FR_Valid_Flg: boolean
  WSS_FL_Valid_Flg: boolean
  WSS_R_Valid_Flg: boolean
  IMU_AccelX_Valid_Flg: boolean
  SensorStuck_Valid_Flg: boolean

IF_SensorFaultFlgs_L2p_IDT = Simulink.Bus(HeaderFile="Rte_Type.h")
  MotorRPM_Fault: boolean
  Accel_Fault: boolean
  WSS_Fault: boolean
  VechSpeedEst_Fault: boolean

w_accel2 = Simulink.Parameter(0.25)
Accel_Diff_Th = Simulink.Parameter(1)
Wheel_Diff_Th = Simulink.Parameter(5)
Speed_Diff_Th = Simulink.Parameter(4)
w_accel1 = Simulink.Parameter(0.75)

SG_mVehCtrlADRq_IDT_E2E = Simulink.Bus(HeaderFile="Rte_Type.h")
  AebEvent: boolean
  AebSrcAD: uint8
  b_High_Deceleration_Flag: boolean
  MsgCntrmVehCtrlADRq: uint8
  MsgCrc_mVehCtrlADRq: uint8
  VehAccelLongCmd: single
  VehDirCmd: uint8
  VehRoadWhlAngleCmd: single
  VehSpdCmd: single
  CanAd78FltCod: uint8

Ki = Simulink.Parameter(0.7)
Kp = Simulink.Parameter(4)

SafetyMode_L2p_IDT = enum(HeaderFile="Rte_Type.h", DefaultValue="AUTONOMOUS", StorageType="uint8")
  AUTONOMOUS = 1
  MANUAL = 0
  TELEOPS = 3

VechSafetyStatus_L2p_IDT = enum(HeaderFile="Rte_Type.h", DefaultValue="NORMAL", StorageType="uint8")
  NORMAL = 0
  DEGRADED = 1
  FAULT_STOP = 3